# Grasshopper definition 1.2_ML_intro_numpy.gh (Grasshopper 1.0.8)
# plug-ins: RhinoCodePluginGH

# ----
# Wickerson Studios Oscillation
trigger = Trigger(Interval=20, TimerInterval=20, Target=data_recorder)  # disabled
data_recorder = DataRecorder("1", DataLimit=10000, RecordData=True)
list_length = ListLength(List=data_recorder)
division = Division(A=list_length, B=Slider(513, range=0..1000))
sine = Sine(Value=division)
cosine = Cosine(Value=division)
number_slider = Slider(-20, range=-20..20)
# Created at
# Wickerson Studios
# copyright 2024
# download all materials at
# www.wickersonstudios.com
# Visualizing Calculus Algorithm
# from
# gpt Image Prompt
multiplication = Multiplication(B=sine)
multiplication_2 = Multiplication(A=Slider(20, range=-20..20), B=cosine)

script = Script()  # -> out, A
# ---------- script: Python ----------
# requirements: numpy

import numpy as np

# Create a 2D array similar to the NumPy array
x = np.array([[1, 2, 3], [4, 5, 6]])

# Print the array
print("x:\n{}".format(x))

# Output the array
A = x
# ---------- end script ----------
param_viewer = ParamViewer(script.out)
panel = Panel(script.A)
