# Grasshopper definition 1.5_ML_intro_pandas_001.gh (Grasshopper 1.0.8)
# plug-ins: RhinoCodePluginGH

# Machine Learning Algorithm
# (***with ghpythonlib.treehelpers
# for DataTrees in gh***)
# Introduction
# pandas
number_slider = Slider(0.7, range=0..1)
# Created at
# Wickerson Studios
# copyright 2024
# download all materials at
# www.wickersonstudios.com
_1_5_ml_intro_pandas_001 = Script()  # -> out, A
# ---------- _1_5_ml_intro_pandas_001: C# ----------
import pandas as pd
import ghpythonlib.treehelpers as th

# Create a simple dataset of people
data = {
    'Name': ["John", "Anna", "Peter", "Linda"],
    'Location' : ["New York", "Paris", "Berlin", "London"],
    'Age' : [24, 13, 53, 33]
}

# Convert the dictionary to a pandas DataFrame
data_pandas = pd.DataFrame(data)

# Convert DataFrame to list of lists (nested list) for each row
data_list = data_pandas.values.tolist()

# Convert nested list to data tree
data_tree = th.list_to_tree(data_list)

# Output data_tree will now contain the DataFrame data in a format usable in Grasshopper
A = data_tree
# ---------- end _1_5_ml_intro_pandas_001 ----------
panel = Panel(_1_5_ml_intro_pandas_001.out)
panel_2 = Panel(_1_5_ml_intro_pandas_001.A)
