# Grasshopper definition 1.6_ML_intro_mglearn_001.gh (Grasshopper 1.0.8)
# plug-ins: RhinoCodePluginGH

# pip install scikit-learn
# # Create a virtual environment
# python -m venv myenv
# 
# # Activate the virtual environment
# myenv\Scripts\activate
# 
# # Now install packages within this environment
# pip install scikit-learn
_1_6_ml_intro_mglearn_001b = Script()  # -> out, A
# ---------- _1_6_ml_intro_mglearn_001b: Python ----------
import sys
#import pandas as pd
import matplotlib
import numpy as np
import scipy as sp
#import IPython
#import sklearn
from Grasshopper import DataTree
from Grasshopper.Kernel.Data import GH_Path

# Function to add text to a DataTree
def add_to_datatree(path, text, tree):
    tree.Add(text, path)

# Create a DataTree to store version information
version_info = DataTree[object]()

# Adding version information to the DataTree
add_to_datatree(GH_Path(0), "Python version: {}".format(sys.version), version_info)
#add_to_datatree(GH_Path(1), "pandas version: {}".format(pd.__version__), version_info)
add_to_datatree(GH_Path(2), "matplotlib version: {}".format(matplotlib.__version__), version_info)
add_to_datatree(GH_Path(3), "NumPy version: {}".format(np.__version__), version_info)
add_to_datatree(GH_Path(4), "SciPy version: {}".format(sp.__version__), version_info)
#add_to_datatree(GH_Path(5), "IPython version: {}".format(IPython.__version__), version_info)
#add_to_datatree(GH_Path(6), "scikit-learn version: {}".format(sklearn.__version__), version_info)

# Output the DataTree
A = version_info
# ---------- end _1_6_ml_intro_mglearn_001b ----------
_1_6_ml_intro_mglearn_001c = Script()  # -> out, A
# ---------- _1_6_ml_intro_mglearn_001c: Python ----------
# requirements: pandas

import pandas as pd
df = pd.DataFrame({'Col1': [1, 2], 'Col2': [3, 4]})
print(df)
# ---------- end _1_6_ml_intro_mglearn_001c ----------
# Machine Learning Algorithm
# (***with ghpythonlib.treehelpers
# for DataTrees in gh***)
# Introduction
# mglearn
_1_6_ml_intro_mglearn_001 = Script()  # -> out, A
# ---------- _1_6_ml_intro_mglearn_001: Python ----------
import numpy as np
from Grasshopper import DataTree
from Grasshopper.Kernel.Data import GH_Path

# Generate synthetic data using numpy
x = np.linspace(-10, 10, 100)
y = np.sin(x) + np.random.normal(size=100) / 3

# Function to convert lists into a Grasshopper DataTree
def list_to_datatree(*lists):
    """ Convert lists to a Grasshopper DataTree """
    dt = DataTree[object]()
    for i, lst in enumerate(lists):
        path = GH_Path(i)
        for item in lst:
            dt.Add(item, path)
    return dt

# Store data in a DataTree
data_tree = list_to_datatree(x, y)

# Output the DataTree for further use in Grasshopper
A = data_tree
# ---------- end _1_6_ml_intro_mglearn_001 ----------
panel = Panel(_1_6_ml_intro_mglearn_001b.A)
panel_2 = Panel(_1_6_ml_intro_mglearn_001c.A)
# Created at
# Wickerson Studios
# copyright 2024
# download all materials at
# www.wickersonstudios.com
panel_3 = Panel(_1_6_ml_intro_mglearn_001.A)
panel_4 = Panel(_1_6_ml_intro_mglearn_001.out)
list_length = ListLength(List=panel_3)
construct_domain = ConstructDomain(DomainStart=Slider(0, range=0..10), DomainEnd=Slider(10, range=0..10))
range = Range(Domain=construct_domain, Steps=expr("x-1", list_length))
construct_point = ConstructPoint(XCoordinate=range, YCoordinate=panel_3, ZCoordinate=0)
interpolate = Interpolate(Vertices=construct_point, Degree=3, Periodic=False, KnotStyle=1)  # -> Curve, Length, Domain
